# Grasshopper definition Greeble.gh (Grasshopper 0.9.76)
# plug-ins: LunchBox, Weaverbird

pt = ConstructPoint(XCoordinate=0, YCoordinate=0, ZCoordinate=0)
msphereex = MeshSphereEx(Base=pt, Radius=Slider(10, range=0..10), Count=5)
c_script = CSharpScript(x=Slider(5, range=0..10))  # -> out, A; inputs x: Int32
# ---------- c_script: C# ----------
    var points = new List<Point3d>();

    for( int i = 0; i < x; ++i )
      for( int j = 0; j < x; ++j )
      {

        points.Add(new Point3d(i, j, 0.5 * ( Math.Sin(i) * Math.Cos(j) )));

      }

    A = points;
# ---------- end c_script ----------
del = DelaunayMesh(Points=c_script.A, Plane=PlaneXY(0, 0, 0))
wbtriangles = WeaverbirdsSplitTrianglesSubdivision(MeshCurves=del, Level=Slider(10, range=0..10))
demesh = DeconstructMesh(Mesh=del)  # -> Vertices, Faces, Colours, Normals
deface = DeconstructFace(Face=demesh.Faces)  # -> CornerA, CornerB, CornerC, CornerD
item = ListItem(List=demesh.Vertices, Index=deface.CornerA, Wrap=True)
item_2 = ListItem(List=demesh.Vertices, Index=deface.CornerB, Wrap=True)
item_3 = ListItem(List=demesh.Vertices, Index=deface.CornerC, Wrap=True)
item_4 = ListItem(List=demesh.Vertices, Index=deface.CornerD, Wrap=True)
dom = ConstructDomain(DomainStart=Slider(0, range=0..1), DomainEnd=Slider(0.5, range=0..10))
lng = ListLength(List=demesh.Faces)
srf4pt = _4PointSurface(CornerA=item, CornerB=item_2, CornerC=item_3, CornerD=item_4)
random = Random(Range=dom, Number=lng, Seed=2)  # -> simplify(Random)
amp = Amplitude(Vector=demesh.Normals, Amplitude=random)
area = Area(Geometry=srf4pt)  # -> Area, Centroid
vdis = VectorDisplay(Anchor=area.Centroid, Vector=amp)
extr = Extrude(Base=srf4pt, Direction=amp)
debrep = DeconstructBrep(Brep=extr)  # -> Faces, Edges, Vertices
item_5 = ListItem(List=debrep.Faces, Index=Slider(4, range=0..10), Wrap=True)  # -> simplify(Item)
wires = BrepWireframe(Brep=item_5, Density=-1)
join = JoinCurves(Curves=wires, Preserve=False)
trisub = SubdivideTriangle(
    TriangularCurve=join,
    Subdivide=Slider(1, range=0..1),
    Boolean1=Toggle(False),
    Boolean2=Toggle(False),
    Boolean3=Toggle(False),
    Boolean4=Toggle(False),
    Wires=Toggle(False))  # -> TriangleCellsA, simplify(TriangleCellsB)
facen = FaceNormals(Mesh=item_5)  # -> Centers, Normals
lng_2 = ListLength(List=flatten(trisub.TriangleCellsB))
panel = Panel(trisub.TriangleCellsB)
dom_2 = ConstructDomain(DomainStart=Slider(0, range=0..1), DomainEnd=Slider(0.5, range=0..10))
area_2 = Area(Geometry=trisub.TriangleCellsB)  # -> Area, Centroid
random_2 = Random(Range=dom_2, Number=lng_2, Seed=2)  # -> flatten(Random)
lng_3 = ListLength(List=trisub.TriangleCellsB)
branch = TreeBranch(Tree=lng_3, Path="{0}", MaintainPaths=True)
partition = PartitionList(List=random_2, Size=branch)
amp_2 = Amplitude(Vector=facen.Normals, Amplitude=partition)
vdis_2 = VectorDisplay(Anchor=area_2.Centroid, Vector=amp_2)
dom_3 = ConstructDomain(DomainStart=Slider(0.7, range=-2..1), DomainEnd=Slider(1, range=0..3))
random_3 = Random(Range=dom_3, Number=lng_2, Seed=Slider(12549129, range=0..100000000))  # -> flatten(Random)
partition_2 = PartitionList(List=random_3, Size=branch)
scale = Scale(Geometry=trisub.TriangleCellsB, Center=area_2.Centroid, Factor=partition_2)  # -> Geometry, Transform
extr_2 = Extrude(Base=scale.Geometry, Direction=amp_2)  # -> simplify(Extrusion)
debrep_2 = DeconstructBrep(Brep=extr_2)  # -> Faces, Edges, Vertices
item_6 = ListItem(List=debrep_2.Faces, Index=Slider(4, range=0..10), Wrap=True)  # -> simplify(Item)
wires_2 = BrepWireframe(Brep=item_6, Density=-1)
join_2 = JoinCurves(Curves=wires_2, Preserve=False)
trisub_2 = SubdivideTriangle(
    TriangularCurve=join_2,
    Subdivide=Slider(1, range=0..1),
    Boolean1=Toggle(False),
    Boolean2=Toggle(False),
    Boolean3=Toggle(False),
    Boolean4=Toggle(False),
    Wires=Toggle(False))  # -> TriangleCellsA, simplify(TriangleCellsB)
facen_2 = FaceNormals(Mesh=item_6)  # -> Centers, Normals
lng_4 = ListLength(List=flatten(trisub_2.TriangleCellsB))
panel_2 = Panel(trisub_2.TriangleCellsB)
dom_4 = ConstructDomain(DomainStart=Slider(0, range=0..1), DomainEnd=Slider(0.3, range=0..10))
area_3 = Area(Geometry=trisub_2.TriangleCellsB)  # -> Area, Centroid
random_4 = Random(Range=dom_4, Number=lng_4, Seed=2)  # -> flatten(Random)
lng_5 = ListLength(List=trisub_2.TriangleCellsB)
branch_2 = TreeBranch(Tree=lng_5, Path="{0;0}", MaintainPaths=True)
partition_3 = PartitionList(List=random_4, Size=branch_2)
amp_3 = Amplitude(Vector=facen_2.Normals, Amplitude=partition_3)
vdis_3 = VectorDisplay(Anchor=area_3.Centroid, Vector=amp_3)
dom_5 = ConstructDomain(DomainStart=Slider(0.3, range=-2..1), DomainEnd=Slider(1, range=0..3))
random_5 = Random(Range=dom_5, Number=lng_4, Seed=Slider(12549129, range=0..100000000))  # -> flatten(Random)
partition_4 = PartitionList(List=random_5, Size=branch_2)
scale_2 = Scale(Geometry=trisub_2.TriangleCellsB, Center=area_3.Centroid, Factor=partition_4)  # -> Geometry, Transform
extr_3 = Extrude(Base=scale_2.Geometry, Direction=amp_3)  # -> simplify(Extrusion)
debrep_3 = DeconstructBrep(Brep=extr_3)  # -> Faces, Edges, Vertices
item_7 = ListItem(List=debrep_3.Faces, Index=Slider(4, range=0..10), Wrap=True)  # -> simplify(Item)
wires_3 = BrepWireframe(Brep=item_7, Density=-1)
join_3 = JoinCurves(Curves=wires_3, Preserve=False)
trisub_3 = SubdivideTriangle(
    TriangularCurve=join_3,
    Subdivide=Slider(1, range=0..1),
    Boolean1=Toggle(False),
    Boolean2=Toggle(False),
    Boolean3=Toggle(False),
    Boolean4=Toggle(False),
    Wires=Toggle(False))  # -> TriangleCellsA, simplify(TriangleCellsB)
facen_3 = FaceNormals(Mesh=item_7)  # -> Centers, Normals
lng_6 = ListLength(List=flatten(trisub_3.TriangleCellsB))
panel_3 = Panel(trisub_3.TriangleCellsB)
dom_6 = ConstructDomain(DomainStart=Slider(0, range=0..1), DomainEnd=Slider(0.2, range=0..10))
area_4 = Area(Geometry=trisub_3.TriangleCellsB)  # -> Area, Centroid
random_6 = Random(Range=dom_6, Number=lng_6, Seed=2)  # -> flatten(Random)
lng_7 = ListLength(List=trisub_3.TriangleCellsB)
branch_3 = TreeBranch(Tree=lng_7, Path="{0;0}", MaintainPaths=True)
partition_5 = PartitionList(List=random_6, Size=branch_3)
amp_4 = Amplitude(Vector=facen_3.Normals, Amplitude=partition_5)
vdis_4 = VectorDisplay(Anchor=area_4.Centroid, Vector=amp_4)
dom_7 = ConstructDomain(DomainStart=Slider(0.3, range=-2..1), DomainEnd=Slider(1, range=0..3))
random_7 = Random(Range=dom_7, Number=lng_6, Seed=Slider(12549129, range=0..100000000))  # -> flatten(Random)
partition_6 = PartitionList(List=random_7, Size=branch_3)
scale_3 = Scale(Geometry=trisub_3.TriangleCellsB, Center=area_4.Centroid, Factor=partition_6)  # -> Geometry, Transform
extr_4 = Extrude(Base=scale_3.Geometry, Direction=amp_4)  # -> simplify(Extrusion)
debrep_4 = DeconstructBrep(Brep=extr_4)  # -> Faces, Edges, Vertices
item_8 = ListItem(List=debrep_4.Faces, Index=Slider(4, range=0..10), Wrap=True)  # -> simplify(Item)
wires_4 = BrepWireframe(Brep=item_8, Density=-1)
join_4 = JoinCurves(Curves=wires_4, Preserve=False)
trisub_4 = SubdivideTriangle(
    TriangularCurve=join_4,
    Subdivide=Slider(1, range=0..1),
    Boolean1=Toggle(False),
    Boolean2=Toggle(False),
    Boolean3=Toggle(False),
    Boolean4=Toggle(False),
    Wires=Toggle(False))  # -> TriangleCellsA, simplify(TriangleCellsB)
facen_4 = FaceNormals(Mesh=item_8)  # -> Centers, Normals
lng_8 = ListLength(List=flatten(trisub_4.TriangleCellsB))
panel_4 = Panel(trisub_4.TriangleCellsB)  # disabled
dom_8 = ConstructDomain(DomainStart=Slider(0, range=0..1), DomainEnd=Slider(0.1, range=0..10))
area_5 = Area(Geometry=trisub_4.TriangleCellsB)  # -> Area, Centroid
random_8 = Random(Range=dom_8, Number=lng_8, Seed=2)  # -> flatten(Random)
lng_9 = ListLength(List=trisub_4.TriangleCellsB)
branch_4 = TreeBranch(Tree=lng_9, Path="{0;0}", MaintainPaths=True)
partition_7 = PartitionList(List=random_8, Size=branch_4)
amp_5 = Amplitude(Vector=facen_4.Normals, Amplitude=partition_7)
vdis_5 = VectorDisplay(Anchor=area_5.Centroid, Vector=amp_5)
dom_9 = ConstructDomain(DomainStart=Slider(0.3, range=-2..1), DomainEnd=Slider(1, range=0..3))
random_9 = Random(Range=dom_9, Number=lng_8, Seed=Slider(12549129, range=0..100000000))  # -> flatten(Random)
partition_8 = PartitionList(List=random_9, Size=branch_4)
scale_4 = Scale(Geometry=trisub_4.TriangleCellsB, Center=area_5.Centroid, Factor=partition_8)  # -> Geometry, Transform
extr_5 = Extrude(Base=scale_4.Geometry, Direction=amp_5)  # -> simplify(Extrusion)
merge = Merge(Data1=extr, Data2=extr_2, Data3=extr_3, Data4=extr_4, Data5=extr_5)
debrep_5 = DeconstructBrep(Brep=extr_5)  # -> Faces, Edges, Vertices; disabled
number_slider = Slider(4, range=0..10)  # disabled
scale_5 = Scale(Center=Point(0, 0, 0), Factor=0.5)  # -> Geometry, Transform; disabled
item_9 = ListItem(List=debrep_5.Faces, Index=number_slider, Wrap=True)  # -> simplify(Item); disabled
wires_5 = BrepWireframe(Brep=item_9, Density=-1)  # disabled
join_5 = JoinCurves(Curves=wires_5, Preserve=False)  # disabled
number_slider_2 = Slider(1, range=0..1)  # disabled
toggle = BooleanToggle(False)  # disabled
toggle_2 = BooleanToggle(False)  # disabled
toggle_3 = BooleanToggle(False)  # disabled
toggle_4 = BooleanToggle(False)  # disabled
toggle_5 = BooleanToggle(False)  # disabled
trisub_5 = SubdivideTriangle(
    TriangularCurve=join_5,
    Subdivide=number_slider_2,
    Boolean1=toggle_2,
    Boolean2=toggle,
    Boolean3=toggle_3,
    Boolean4=toggle_4,
    Wires=toggle_5)  # -> TriangleCellsA, simplify(TriangleCellsB); disabled
number_slider_3 = Slider(0, range=0..1)  # disabled
number_slider_4 = Slider(0.3, range=0..10)  # disabled
facen_5 = FaceNormals(Mesh=item_9)  # -> Centers, Normals; disabled
lng_10 = ListLength(List=flatten(trisub_5.TriangleCellsB))  # disabled
panel_5 = Panel(trisub_5.TriangleCellsB)  # disabled
dom_10 = ConstructDomain(DomainStart=number_slider_3, DomainEnd=number_slider_4)  # disabled
area_6 = Area(Geometry=trisub_5.TriangleCellsB)  # -> Area, Centroid; disabled
random_10 = Random(Range=dom_10, Number=lng_10, Seed=2)  # -> flatten(Random); disabled
lng_11 = ListLength(List=trisub_5.TriangleCellsB)  # disabled
panel_6 = Panel("{0;0}")  # disabled
branch_5 = TreeBranch(Tree=lng_11, Path=panel_6, MaintainPaths=True)  # disabled
partition_9 = PartitionList(List=random_10, Size=branch_5)  # disabled
amp_6 = Amplitude(Vector=facen_5.Normals, Amplitude=partition_9)  # disabled
vdis_6 = VectorDisplay(Anchor=area_6.Centroid, Vector=amp_6)  # disabled
number_slider_5 = Slider(0.3, range=-2..1)  # disabled
number_slider_6 = Slider(1, range=0..3)  # disabled
dom_11 = ConstructDomain(DomainStart=number_slider_5, DomainEnd=number_slider_6)  # disabled
number_slider_7 = Slider(12549129, range=0..100000000)  # disabled
random_11 = Random(Range=dom_11, Number=lng_10, Seed=number_slider_7)  # -> flatten(Random); disabled
partition_10 = PartitionList(List=random_11, Size=branch_5)  # disabled
scale_6 = Scale(Geometry=trisub_5.TriangleCellsB, Center=area_6.Centroid, Factor=partition_10)  # -> Geometry, Transform; disabled
extr_6 = Extrude(Base=scale_6.Geometry, Direction=amp_6)  # -> simplify(Extrusion); disabled
